# Dynamo custom node VisualiseCoordinateSystem.dyf (Dynamo 4.1.1.5050)
# category: ArgaLink
# Displays a coordinate system with clear, colour-coded X, Y and Z axes in Dynamo's 3D background preview.

coordinateSystem = Input(coordinateSystem: Autodesk.DesignScript.Geometry.CoordinateSystem = Autodesk.DesignScript.Geometry.CoordinateSystem.ByOrigin(Autodesk.DesignScript.Geometry.Point.ByCoordinates(0, 0, 0)))  # Coordinate System
origin = CoordinateSystem.Origin(coordinateSystem=coordinateSystem)
XAxis = CoordinateSystem.XAxis(coordinateSystem=coordinateSystem)
YAxis = CoordinateSystem.YAxis(coordinateSystem=coordinateSystem)
ZAxis = CoordinateSystem.ZAxis(coordinateSystem=coordinateSystem)
list_create = List.Create(item0=XAxis, item1=YAxis, item2=ZAxis)
scale = Input(scale: double = 20)  # Scale
byStartPointDirectionLength = Line.ByStartPointDirectionLength(startPoint=origin, direction=list_create, length=scale)
endPoint = Curve.EndPoint(curve=byStartPointDirectionLength)
number = DoubleInput(0.03)
mul = scale * number
scale_2 = Vector.Scale(vector=list_create, scale_factor=mul)
translate = Geometry.Translate(geometry=endPoint, direction=scale_2)
string = StringInput("X")
string_2 = StringInput("Y")
string_3 = StringInput("Z")
list_create_2 = List.Create(item0=string, item1=string_2, item2=string_3)
byPointAndString = Analysis.Label.ByPointAndString(point=translate, label=list_create_2)
labels = Output(byPointAndString)  # "labels : Label[]"; XYZ labels
number_2 = DoubleInput(255)
number_3 = DoubleInput(0)
byARGB = Color.ByARGB(alpha=number_2, red=number_2, green=number_3, blue=number_3)
byARGB_2 = Color.ByARGB(alpha=number_2, red=number_3, green=number_2, blue=number_3)
byARGB_3 = Color.ByARGB(alpha=number_2, red=number_3, green=number_3, blue=number_2)
list_create_3 = List.Create(item0=byARGB, item1=byARGB_2, item2=byARGB_3)
byGeometryColor = Modifiers.GeometryColor.ByGeometryColor(geometry=byStartPointDirectionLength, color=list_create_3)
firstItem = List.FirstItem(list=byGeometryColor)
xAxis = Output(firstItem)  # "xAxis : GeometryColor"; X Geometry Color
number_4 = DoubleInput(1)
getItemAtIndex = List.GetItemAtIndex(list=byGeometryColor, index=number_4)
yAxis = Output(getItemAtIndex)  # "yAxis : GeometryColor"; Y Geometry Color
lastItem = List.LastItem(list=byGeometryColor)
zAxis = Output(lastItem)  # "zAxis : GeometryColor"; Z Geometry Color
labelPoints = Output(translate)  # "labelPoints : Point[]"; labelPoints
