# Dynamo custom node VisualiseVector.dyf (Dynamo 4.1.1.5050)
# category: ArgaLink
# Displays a vector with enhanced visibility in Dynamo's 3D background preview, making its direction easier to identify.

point = Input(point: Autodesk.DesignScript.Geometry.Point[] = Autodesk.DesignScript.Geometry.Point.Origin())  # Point
vector = Input(vector: Autodesk.DesignScript.Geometry.Vector[] = Autodesk.DesignScript.Geometry.Vector.ZAxis())  # Vector
scale = Input(scale: double = 20)  # Scale
byStartPointDirectionLength = Line.ByStartPointDirectionLength(startPoint=point, direction=vector, length=scale)
number = DoubleInput(0.9)
pointAtParameter = Curve.PointAtParameter(curve=byStartPointDirectionLength, param=number)
endPoint = Curve.EndPoint(curve=byStartPointDirectionLength)
distanceTo = Geometry.DistanceTo(geometry=endPoint, entity=pointAtParameter)
number_2 = DoubleInput(2)
div = distanceTo / number_2
byPointsRadius = Cone.ByPointsRadius(startPoint=pointAtParameter, endPoint=endPoint, startRadius=div)
list_create = List.Create(item0=byStartPointDirectionLength, item1=byPointsRadius)
number_3 = DoubleInput(255)
number_4 = DoubleInput(0)
byARGB = Color.ByARGB(alpha=number_3, red=number_3, green=number_4, blue=number_3)
byGeometryColor = Modifiers.GeometryColor.ByGeometryColor(geometry=list_create, color=byARGB)
firstItem = List.FirstItem(list=byGeometryColor)
vector_2 = Output(firstItem)  # "vector : GeometryColor"; Geometry Color
lastItem = List.LastItem(list=byGeometryColor)
cone = Output(lastItem)  # "cone : GeometryColor"; Geometry Color
