# Dynamo custom node VisualizePlane.dyf (Dynamo 4.1.1.5050)
# category: ArgaLink
# Displays a plane with enhanced visibility, including its normal direction, in Dynamo's 3D background preview.

plane = Input(plane: Autodesk.DesignScript.Geometry.Plane[])  # Plane
scale = Input(scale: double = 20)  # Scale
byWidthLength = Rectangle.ByWidthLength(plane=plane, width=scale, length=scale)
byPatch = Surface.ByPatch(closedCurve=byWidthLength)
origin = Plane.Origin(plane=plane)
normal = Plane.Normal(plane=plane)
number = DoubleInput(2)
div = scale / number
byStartPointDirectionLength = Line.ByStartPointDirectionLength(startPoint=origin, direction=normal, length=div)
list_create = List.Create(item0=byPatch, item1=byStartPointDirectionLength)
number_2 = DoubleInput(255)
number_3 = DoubleInput(0)
byARGB = Color.ByARGB(alpha=number_2, red=number_2, green=number_3, blue=number_2)
byGeometryColor = Modifiers.GeometryColor.ByGeometryColor(geometry=list_create, color=byARGB)
firstItem = List.FirstItem(list=byGeometryColor)
coloredPlane = Output(firstItem)  # "coloredPlane : GeometryColor"; Geometry Color
lastItem = List.LastItem(list=byGeometryColor)
normal_2 = Output(lastItem)  # "normal : GeometryColor"; GeometryColor
